# Grasshopper definition mass_production.gh (Grasshopper 1.0.7)

c_script = CSharpScript(
    Addr="ws://127.0.0.1:782",
    Start=Toggle(True),
    Reference="\\Mac\Home\Desktop\wssharp\wssharp\packages\WebSocketSharp.1.0.3-rc11\lib\websocket-sharp.dll")  # -> out, wss, Status; inputs Addr: String, Start: Boolean
# ---------- c_script: C# usings ----------
using WebSocketSharp;
using WebSocketSharp.Server;
# ---------- c_script: C# ----------
    var wsserver = new WebSocketServer(Addr);
    string a;
    wss = wsserver;
    wsserver.AddWebSocketService<Echo>("/Echo");
    //wsserver.AuthenticationSchemes = WebSocketSharp.Net.AuthenticationSchemes.Basic;
    wsserver.SslConfiguration.EnabledSslProtocols = System.Security.Authentication.SslProtocols.None;
    wsserver.SslConfiguration.CheckCertificateRevocation = false;
    wsserver.SslConfiguration.ClientCertificateRequired = false;
    wsserver.AuthenticationSchemes = WebSocketSharp.Net.AuthenticationSchemes.None;

    if (Start) {
      wsserver.Start();


      //wsserver.AddWebSocketService;
      a = "Hello World";
    }
    else {
      a = "Fail";
      wsserver.Stop();
    }
    //string b = wsserver.Address;
    Status = wsserver.IsListening;
# ---------- c_script: C# additional code ----------
  public class Echo : WebSocketBehavior {
    protected override void OnMessage (MessageEventArgs e) {
      Send(e.Data);
    }
  }
# ---------- end c_script ----------
websocket_client_start = WebsocketClientStart(Address="ws://127.0.0.1:782", InitalMessage="Hello, this is GH", Reset=Toggle(True))
panel = Panel(c_script.Status)
panel_2 = Panel(c_script.wss)
file = ReadFile(File="C:\Users\pengcheng\Downloads\shapes.txt", PerLineParse=True)
websocket_client_sender = WebsocketClientSender(WebsocketObjects=websocket_client_start, Message="Hello World")
c_script_2 = CSharpScript(draft=file)  # -> out, pl, program, hKey; inputs draft: String
# ---------- c_script_2: C# ----------
    string[] dataColumns = draft.Split(',');
    program = dataColumns[dataColumns.Length - 3];
    hKey = dataColumns[dataColumns.Length - 2];


    List<Point3d> Pts = new List<Point3d>();
    for (int i = 0; i < dataColumns.Length - 3; i += 2)
    {
      Point3d tempPt = new Point3d(Convert.ToDouble(dataColumns[i]), Convert.ToDouble(dataColumns[i + 1]), 0);
      Pts.Add(tempPt);
    }

    Pts.Add(Pts[0]);


    Polyline shape = new Polyline(Pts);

    pl = shape;
# ---------- end c_script_2 ----------

python = GhPythonScript(hKey=c_script_2.hKey)  # -> out, bld_height, storyH
# ---------- python: Python ----------
__author__ = "pengcheng"
__version__ = "2019.11.30"

import rhinoscriptsyntax as rs
import random


storyH = 30
if hKey == "1-3":
    low = 1
    high = 3
elif hKey == "4-6":
    low = 4
    high = 6
elif hKey == "9-12":
    low = 9
    high = 12

bld_height = random.randint(low, high) * storyH
# ---------- end python ----------
c_script_3 = CSharpScript(pl=c_script_2.pl, height=python.bld_height)  # -> out, A; inputs pl: Curve, height: Double
# ---------- c_script_3: C# ----------
    Vector3d EDir = new Vector3d(0, 0, 1);
    EDir = Vector3d.Multiply(EDir, height);

    Surface Ext = Surface.CreateExtrusion(pl, EDir);

    A = Ext;
# ---------- end c_script_3 ----------
cap = CapHoles(Brep=c_script_3.A)

python_2 = GhPythonScript(raw_program=c_script_2.program)  # -> out, filtered_p; inputs raw_program: list
# ---------- python_2: Python ----------
__author__ = "pengcheng"
__version__ = "2019.12.15"

import rhinoscriptsyntax as rs

filtered_p = []

for p in raw_program:
    if p != "void":
        filtered_p.append(p)

filtered = filtered_p
# ---------- end python_2 ----------
python_3 = GhPythonScript(program=python_2.filtered_p)  # -> out, colors
# ---------- python_3: Python ----------
__author__ = "pengcheng"
__version__ = "2019.11.30"

import rhinoscriptsyntax as rs



if program == "retail":
    color = [255, 0, 0]
elif program == "residential":
    color = [255, 255, 0]
elif program == "office":
    color = [0,255,0]

colors = color
# ---------- end python_3 ----------

c_script_4 = CSharpScript(breps=cap, programs=c_script_2.program)  # -> out, SubBld; inputs breps: list of Brep, programs: list of String
# ---------- c_script_4: C# ----------
    List<Brep> Blds = new List<Brep>();
    List<Brep> Voids = new List<Brep>();
    for (int i = 0; i < programs.Count; i++)
    {
      if( programs[i] == "void")
      {
        Voids.Add(breps[i]);
      }
      else
      {
        Blds.Add(breps[i]);
      }
    }

    //Brep[] sub = Brep.CreateBooleanDifference(Blds[0], Blds[1], 0.01);
    if (Voids.Count == 0)
    {
      SubBld = Blds;
    }
    else
    {
      Rhino.Geometry.Brep[] sub = Rhino.Geometry.Brep.CreateBooleanDifference(Blds, Voids, 0.01);
      SubBld = sub;
    }
# ---------- end c_script_4 ----------
pt = Point(<point referenced from the Rhino model>)
xz = XZPlane(Origin=pt)
mirror = Mirror(Geometry=c_script_4.SubBld, Plane=xz)  # -> Geometry, Transform

crv = Curve(<curve referenced from the Rhino model>)
crv_2 = Curve(<curve referenced from the Rhino model>)
crv_3 = Curve(<curve referenced from the Rhino model>)
crv_4 = Curve(<curve referenced from the Rhino model>)
crv_5 = Curve(<curve referenced from the Rhino model>)
merge = Merge(Data1=crv, Data2=crv_2, Data3=crv_3, Data4=crv_4, Data5=crv_5)
Z = UnitZ(Factor=Slider(1192, range=0..2100))
lng = ListLength(List=merge)
extr = Extrude(Base=merge, Direction=Z)  # -> graft(Extrusion)
series = Series(Start=Slider(13814, range=0..21000), Step=Slider(600, range=0..1000), Count=lng)
brep = Brep(<brep referenced from the Rhino model>)
bbx = BrepBrep(BrepA=extr, BrepB=mirror.Geometry)  # -> Curves, Points
swatch = ColourSwatch(SwatchColor=RGB(0, 0, 0))
swatch_2 = ColourSwatch(SwatchColor=RGB(148, 148, 148))
trim = TrimTree(Tree=bbx.Curves, Depth=1)
bbx_2 = BrepBrep(BrepA=extr, BrepB=brep)  # -> Curves, Points
Z_2 = UnitZ(Factor=series)
srf = Surface(trim)
move = Move(Geometry=bbx_2.Curves, Motion=graft(Z_2))  # -> Geometry, Transform
Z_3 = UnitZ(Factor=series)
srf_2 = Surface(move.Geometry)
move_2 = Move(Geometry=srf, Motion=graft(Z_3))  # -> Geometry, Transform
preview = CustomPreview(Geometry=srf_2, Material=swatch_2)
preview_2 = CustomPreview(Geometry=move_2.Geometry, Material=swatch)

# ---- group: Visualize Massin
item = ListItem(List=python_3.colors, Index=0, Wrap=True)  # -> Item, Item1, Item2
rgb = ColourRGB(Alpha=255, Red=flatten(item.Item), Green=flatten(item.Item1), Blue=flatten(item.Item2))
material = CreateMaterial(Diffuse=rgb, Specular=RGB(255, 255, 255), Emission=RGB(0, 0, 0), Transparency=Slider(0.5, range=0..1), Shine=0)
preview_3 = CustomPreview(Geometry=mirror.Geometry, Material=material)

# ---- group: Visualize Floor
Z_4 = UnitZ(Factor=1)
contour = Contour(Shape=mirror.Geometry, Point=Point(0, 0, 0), Direction=Z_4, Distance=python.storyH)
trim_2 = TrimTree(Tree=contour, Depth=1)
preview_4 = CustomPreview(Geometry=trim_2, Material=graft(ColourSwatch(SwatchColor=RGB(255, 255, 255))))

# ----
brep_2 = Brep([<brep referenced from the Rhino model> x292])
brep_3 = Brep([<brep referenced from the Rhino model> x16])
Y = UnitY(Factor=Slider(14023, range=0..24000))
move_3 = Move(Geometry=mirror.Geometry, Motion=Y)  # -> Geometry, Transform
move_4 = Move(Geometry=brep_2, Motion=Y)  # -> Geometry, Transform
move_5 = Move(Geometry=brep_3, Motion=Y)  # -> Geometry, Transform
preview_5 = CustomPreview(Geometry=move_3.Geometry, Material=swatch)
preview_6 = CustomPreview(Geometry=move_4.Geometry, Material=swatch)
preview_7 = CustomPreview(Geometry=move_5.Geometry, Material=swatch_2)
